# Grasshopper definition SynapseExample.gh (Grasshopper 1.0.7)
# plug-ins: Synapse

panel = Panel("""DecimalPlaces
Increment""")
panel_2 = Panel("""sliderwidth
maxvalue
minvalue
steps""")
argb = SplitARGB(Colour=ColourSwatch(SwatchColor=RGB(50, 132, 209)), IntegerChannels=True)  # -> Alpha, Red, Green, Blue
scolor = SynapseColor(Alpha=argb.Alpha, Red=argb.Red, Green=argb.Green, Blue=argb.Blue)
sfont = SynapseFont(FontFamily="Lucida Console", FontSize=8.25, FontStyle=0, Decoration=0)
panel_3 = Panel("""2
2""")
int = Integer("10")
int_2 = Integer("125")
int_3 = Integer(panel_3)
slabel = SynapseLabel(Property=flatten("text"), PropertyValue=flatten("object name"))  # -> AllProperties, Control
snud = SynapseNumUpDn(Property=flatten(panel), PropertyValue=flatten(int_3))  # -> AllProperties, Control
sbutton = SynapseButton(Property=flatten("Font"), PropertyValue=flatten(sfont))  # -> AllProperties, Control
scheckbox = SynapseCheckBox(Property=flatten("TextColor"), PropertyValue=flatten(ColourSwatch(SwatchColor=RGB(178, 43, 154))))  # -> AllProperties, Control
pickone = SynapseSingleSelect(Options=flatten(["Alpha", "Beta", "Omega"]))  # -> AllProperties, Control
stb = SynapseTextBox(Property=flatten("TextColor"), PropertyValue=flatten(scolor))  # -> AllProperties, Control
sslider = SynapseSlider(Property=flatten(panel_2), PropertyValue=flatten([int_2, "0.5", "0.2", "5"]), Coefficient=0.01)  # -> AllProperties, Control
X = Slider(27, range=1..50, expression="x*10")
# some properties won't convert data type automatically;
# manually enforce the integer type
D = Slider(14, range=5..20)
panel_4 = Panel("""Click
Type
Select""")
size = SynapseSize(Width=Slider(262, range=100..800), Height=Slider(220, range=100..800))
int_4 = Integer(X)
int_5 = Integer(D)
merge = Merge(Data1=flatten(int_5), Data2=flatten(int_5), Data3=int_4)
merge_2 = Merge(
    Data1=flatten(scheckbox.Control),
    Data2=flatten(sbutton.Control),
    Data3=flatten(slabel.Control),
    Data4=flatten(pickone.Control),
    Data5=flatten(snud.Control),
    Data6=flatten(sslider.Control),
    Data7=flatten(stb.Control))
sstack = SynapseStack(Property=flatten("Size"), PropertyValue=flatten(size))  # -> AllProperties, Control
sstack_2 = SynapseStack(Property=flatten("Size"), PropertyValue=flatten(size))  # -> AllProperties, Control
sstack_3 = SynapseStack(Property=flatten("Size"), PropertyValue=flatten(size))  # -> AllProperties, Control
panel_5 = Panel("""padding
spacing
Width""")
txy = SynapseTableXY(Controls=merge_2, Columns=2)  # -> Coordinates, Dimensions
value = ValueQuery(SynapseObject=merge_2)
Y = Slider(30, range=1..50, expression="x*10")
X_2 = Slider(30, range=1..50, expression="x*10")
tab = SynapseTabs(Controls=flatten([sstack_2.Control, sstack.Control, sstack_3.Control]), TabName=flatten(panel_4))  # -> AllProperties, Control; disabled
value_2 = ValueQuery()
table = SynapseTable(
    Property=flatten(panel_5),
    PropertyValue=flatten(merge),
    Controls=flatten(merge_2),
    ControlLocation=flatten(txy.Coordinates),
    TableDimension=txy.Dimensions)  # -> AllProperties, Control
pypt = GhPythonScript(x=Slider(50, range=1..50, expression="x*10"), y=Slider(50, range=1..50, expression="x*10"))  # -> out, p; inputs x: Int32, y: Int32
# ---------- pypt: Python ----------
"""creating an Eto.Drawing.Point object for Synapse plugin to consume.
    Inputs:
        x: x coordinate
        y: y coordinate
    Output:
        p: point object"""

__author__ = "wwang"
__version__ = "2021.02.19"

import Eto.Drawing as drw

p = drw.Point(x,y)
# ---------- end pypt ----------
watcher = Panel(value_2)
padding = Slider(5, range=1..15)
vec = VectorXYZ(XComponent=X_2, YComponent=Y, ZComponent=0)  # -> Vector, Length
resizable = BooleanToggle(False)
topmost = BooleanToggle(True)
int_6 = Integer(padding)
merge_3 = Merge(
    Data1=flatten(scolor),
    Data2=flatten("NimbleDashboard"),
    Data3=flatten(pypt.p),
    Data4=flatten(vec.Vector),
    Data5=flatten(topmost),
    Data6=flatten(int_6),
    Data7=flatten(resizable))
panel_6 = Panel("""color
title
Location
size
Topmost
Padding
Resizable""")
showwindow = BooleanToggle(False)
swindow = SynapseWindow(
    Show=showwindow,
    Property=flatten(panel_6),
    PropertyValue=flatten(merge_3),
    Contents=flatten(table.Control),
    ctrlfill=False)
